# Requirement set Missile_Reqs (R2025b)

## 1 [RFP - T] Cost
The missile’s unit cost shall not exceed $500,000 (Fiscal Year 24-25).

## 2 [RFP - T] Production Run
The missile shall have a production run of 1200 missiles per year for 10 years, as well as 100 more for developmental testing

## 3 [RFP - T] Surge Production
The missile shall have a surge production capability of fabricating 24 units per week to 72 units per week, within a week, to be held indefinitely

## 4 [RFP - T] Range
The missile’s range shall be 500 nm from launch to impact

## 5 [RFP - T] Mark 41 VLS
The missile shall be capable of being launched from land/ship-based Mark 41 VLS

## 6 [RFP] Air Launch
Missile must be capable of air launch at Mach 0.8 at 30,000 ft.

## 7 [RFP - T] Lethality
The warhead shall be sized to neutralize a single target

## 8 [RFP - T] Warhead Size
The warhead shall be sized to neutralize a single target

## 9 [RFP - O] Cruise Speed
The missile must have a minimum cruise speed above Mach 3.

## 10 [RFP - T] Shelf Life
The missile and every physical component shall have a shelf life of at least 10 years without maintenance.

## 11 [RFP - T] Entry into Service
Design/Development shall commence no later than October 2026 and IOC shall occur no later than December 2031.

## 12 [RFP] Land Based Launch (HIMARS)
The missile must be able to be launched from Mobile land-based launchers (ie, HIMRAS, MLRS). Launch weight < 2000 lbm.

## 13 [RFP] External Fighter
Missile must launch form an external fighter hard point. Launch weight < 2000 lbm.

## 14 [RFP] Submarine
Missile must launch from a submarine tube. Launch weight < 3500 lbm.

## 15 [RFP] Internal Fighter
Must launch from a figher internal carriage. Launch weight < 2000 lbm.

## 16 [RFP] Dimensions
Missile fits in a 15 x 15 x 144 in box.

## 17 [RFP] Data Links
Missile will have data link commands to include changes in-flight

## 18 [RFP] Low-Level Ingress
Missile must have a low-level ingress to its target, traveling <= 500 ft AGL for the last 10% of its mission.

## 19 [MIL-M-8856B] Factor Safety
Factor of safety will be a minimum of 1.5 for in-flight, storage, and transportation.

## 20 [MIL-M-8856B] Faliure under Ultimate Mission Load
The structure will not fail under the ultimate load condition outlined in the mission profile

## 21 [MIL-STD-1522A] Extreme Temp
Materials will be constructed based on extreme temperature cases seen during the mission profile

## 22 [MIL-M-8856B] Heating Effects
Missile design shall provide for the cummulative heating effect from internal and external heating

## 23 [MIL-M-8856B] Fatigue Life
The fatigue life of the structure will equal or exceed the specified life

## 24 [SMC-S-006] Proof Pressure
Missile shall sustain specified proof pressure without any detrimental deformation

## 25 [SMC-S-006] Minimum Proof Pressure
Minimum proof pressure will be 1.1 time the maximum expected operating pressure

## 26 [SMC-S-006] Stiffness
All components will have enough stiffness to handle deformation at limit load

## 27 [SMC-S-006] Loading with Cracks
Components will handle loads even with existing crack

## 28 [SMC-S-006] Fracture Toughness
Fracture toughness in materials must be at a minimum of 60% of the plain strain toughness

## 29 [SMC-S-006] Fabrication
Fabrication of materials will be within acceptable variable ranges and perform reliably

## 30 [MIL-STD-1522A] Internal Pressure
The system will maintain safe conditions for pressure level inside necessary for flight conditions outlined

## 31 [MIL-STD-1901A] Ignition System Protection
For safe storage, the ignition system will not arm during exposure to electronic attacks(ie. EMR, ESD,EMP)

## 32 [RTCA-DO-178] Software
Missile software will comply to military software guidance

## 33 [MIL-STD-1760] Connection Interface
Missile will be compatible to standard aircraft weapon connection interface

## 34 [MIL-STD-704] Electric Power Standard
Missile will comply to military electric power standard

## 35 [MIL-STD-6016] Data Link System
Missile will be compatible to link 16 data link system

## 36 [MIL-STD-461] Electromagnetic Resistance
Missile will be redundant to electromagnetic interference

## 37 [MIL-HDBK-781] Reliability
Missile will meet military reliability requirement

## 38 [RCTA-DO-160] Aerial Durability
Missile will have durability required to endure aerial environmental challenge

## 39 [MIL-STD-810] Ground Durability
Missile will have durability required to endure ground environemntal challenge

## 40 [MIL-STD-882] Safety Req.
Missile will meet military safety requirement