% Requirement links of Cruise_Speed_Test.m (R2025b)

% lines 5-8 verifies Missile_Reqs.slreqx#3
        function cruise_speed_test_1(testCase)
            actualspeed = Cruise_Speed_Function();
            testCase.verifyGreaterThan(actualspeed, 3)
        end