% Requirement links of Cruise_Metrics_Test.m (R2025b)

% line 5 verifies Missile_Reqs.slreqx#3
            [~, ~, ~, cruise_Mach, ~] = Scorpius_Trajectory();

% line 10 verifies Missile_Reqs.slreqx#2
            [~, ~, ~, ~, maxRange_nm] = Scorpius_Trajectory();

% line 15 verifies Missile_Reqs.slreqx#17
            [launch_mode, launch_Mach, launch_alt_ft, ~, ~] = Scorpius_Trajectory();