% Requirement links of Weight_Tests.m (R2025b)

% line 3 verifies Missile_Reqs.slreqx#8
% line 3 verifies Missile_Reqs.slreqx#6
% line 3 verifies Missile_Reqs.slreqx#5
        function HIMARS_Fighter(testCase)

% line 7 verifies Missile_Reqs.slreqx#7
        function submarine(testCase)

% line 11 verifies Missile_Reqs.slreqx#4
        function mark41VLS(testCase)